# Grasshopper definition Python Animation Tutorial_IN CLASS TUTORIAL.gh (Grasshopper 0.9.76)
# plug-ins: Python Interpreter

height_of_camera_focus = Slider(9, range=0..100)
number_of_frames = Slider(100, range=0..100)
animation_frame = Slider(51, range=0..100)
panel = Panel("number of frames")
unit_z = UnitZ(Factor=height_of_camera_focus)
camera_path = Curve(<curve referenced from the Rhino model>)
divide_curve = DivideCurve(Curve=camera_path, Count=number_of_frames, Kinks=False)  # -> Points, Tangents, Parameters
list_item = ListItem(List=divide_curve.Points, Index=animation_frame, Wrap=True)

movefactor = Slider(1.31, range=0..5)
size = Slider(2, range=1..5)
random_seed = Slider(39539, range=0..100000)
start_point = Point(<point referenced from the Rhino model>)
construct_domain = ConstructDomain(DomainStart=0, DomainEnd=animation_frame)
geometry = PythonScript(startPoint=start_point, size=size, moveFactor=movefactor, randomSeed=random_seed)  # -> out, a
# ---------- geometry: Python ----------
import rhinoscriptsyntax as rs
from Rhino.Geometry import Point3d
import random

random.seed(randomSeed)




def boxMaker(firstPoint, recursion):
    
    a.append(firstPoint)
    
    moveX = random.uniform(-size*moveFactor, size*moveFactor)
    moveY = random.uniform(-size*moveFactor, size*moveFactor)
    
    if recursion < 10:
        movedPoint1 = firstPoint + Point3d(moveX,moveY,size)
        boxMaker(movedPoint1, recursion +1)
        
        if abs(moveX) > size * .5 and abs(moveY) > size *.5:
            movedPoint2 = firstPoint + Point3d(-moveX,-moveY,size)
            boxMaker(movedPoint2, recursion +1)

firstPoint = rs.coerce3dpoint(startPoint)

a = []

boxMaker(firstPoint, 0)
# ---------- end geometry ----------
sub_list = SubList(List=geometry.a, Domain=construct_domain, Wrap=True)  # -> List, Index

list_length = ListLength(List=geometry.a)  # disabled
construct_domain_2 = ConstructDomain(DomainStart=0, DomainEnd="100")  # disabled
construct_domain_3 = ConstructDomain(DomainStart=0, DomainEnd=animation_frame)  # disabled
construct_domain_4 = ConstructDomain(DomainStart=0, DomainEnd=list_length)  # disabled
remap_numbers = RemapNumbers(Value=construct_domain_3, Source=construct_domain_2, Target=construct_domain_4)  # -> Mapped, Clipped; disabled
construct_domain_5 = ConstructDomain(DomainStart=0, DomainEnd=remap_numbers.Mapped)  # disabled

panel_2 = Panel(construct_domain_3)

move = Move(Geometry=start_point, Motion=unit_z)  # -> Geometry, Transform
camera = PythonScript(location=list_item, target=move.Geometry)  # -> out, a
# ---------- camera: Python ----------
import rhinoscriptsyntax as rs
import scriptcontext as sc

sc.doc = ghdoc

loc = rs.coerce3dpoint(location)
tar = rs.coerce3dpoint(target)

vp = sc.doc.Views.ActiveView.ActiveViewport #this over my head
vp.SetCameraLocation(loc, False)
vp.SetCameraDirection(tar - loc, True)
# ---------- end camera ----------

vector_xyz = VectorXYZ(XComponent=size, YComponent=size, ZComponent=size)  # -> Vector, Length
move_2 = Move(Geometry=sub_list.List, Motion=vector_xyz.Vector)  # -> Geometry, Transform
box_2pt = Box2Pt(PointA=sub_list.List, PointB=move_2.Geometry, Plane=PlaneXY(0, 0, 0))

panel_3 = Panel(geometry.a)

baking_objects = PythonScript(active=Toggle(False), geo=box_2pt, layer="Layer 01")  # -> out, C; inputs geo: list
# ---------- baking_objects: Python ----------
import rhinoscriptsyntax as rs
import scriptcontext as sc
import Rhino

if active:
    
    for i in range(len(geo)):
        
        geo_id = geo[i]
        
        sc.doc = ghdoc
        
        doc_object = rs.coercerhinoobject(geo_id)
        
        
        geometry = doc_object.Geometry
        attributes = doc_object.Attributes
        
        sc.doc = Rhino.RhinoDoc.ActiveDoc
        
        rhino_ref = sc.doc.Objects.Add(geometry, attributes)
        
        rs.ObjectLayer(rhino_ref, layer)
    
    C = True
else:
    C = False
# ---------- end baking_objects ----------
rendering_objects = PythonScript(active=baking_objects.C, filePath="C:\Users\Dustin\Desktop\AnimationTutorial\", current=animation_frame)  # -> out, C
# ---------- rendering_objects: Python ----------
import rhinoscriptsyntax as rs


if active:
    
    
    rs.Command("_Render")
    
    #savedLocation = filePath + str(int(current)).zfill(4) + ".png"
    
    #rs.Command("_-SaveRenderWindowAs \n\"" + savedLocation + "\"\n")
    #rs.Command("_-CloseRenderWindow")
    C = True
else:
    C = False
# ---------- end rendering_objects ----------
deleting_objects = PythonScript(active=rendering_objects.C, layer="Layer 01")  # -> out, a
# ---------- deleting_objects: Python ----------
import rhinoscriptsyntax as rs
import scriptcontext as sc
import Rhino

if layer:
    sc.doc = Rhino.RhinoDoc.ActiveDoc
    objs = rs.ObjectsByLayer(layer)
    rs.DeleteObjects(objs)
# ---------- end deleting_objects ----------
