# Grasshopper definition audio_field_animation.gh (Grasshopper 0.9.76)
# plug-ins: MarchingCubes, Python Interpreter, Weaverbird

# ----
# sound source 1
panel = Panel("C:\Users\master\Google Drive\ARCH 5350\final\data\poeme_[loudness]_[scalars]")

# ----
# right click > "set one file path"
# and navigate to sound data file
# file import
path = FilePath(panel)

# ----
# the file i showed on Sunday was audio sampled for loudness to scale the deform vector field
# 
# no point data should be in the file, it should just be a list of scalars
file = ReadFile(File=path, PerLineParse=True)
num = Number(file)

# ----
# right now this works by taking normalized data (i.e. from 0 to 1) and subtracting .5, so it ranges from -.5 to .5
# 
# then, the new values are compared to a threshold both positive and negative, and filters out only those above the threshold, for example a threshold of .2 would result in values above .2 or below -.2 getting 'true'
# split against threshold
number_slider = Slider(0.06, range=0..1)
subtraction = Subtraction(A=num, B=number_slider)
number_slider_2 = Slider(0, range=0..1)
neg = Negative(Value=number_slider_2)
smaller = SmallerThan(FirstNumber=subtraction, SecondNumber=neg)  # -> SmallerThan, OrEqualTo
larger = LargerThan(FirstNumber=subtraction, SecondNumber=number_slider_2)  # -> LargerThan, OrEqualTo
or = GateOr(A=smaller.SmallerThan, B=larger.LargerThan)
dispatch = Dispatch(List=subtraction, DispatchPattern=or)  # -> ListA, ListB
panel_2 = Panel(dispatch.ListB)
panel_3 = Panel(dispatch.ListA)

# ----
# scale sound data to effective point charge range
# add/sub with original value to have
# all repel/attract respectively
digit_scroller = DigitScroller(Scroller_Digits=12, Scroller_Prefix="A", Scroller_Radix=11, Scroller_Value=5000)
multiplication = Multiplication(A=digit_scroller, B=dispatch.ListA)
addition = Addition(A=digit_scroller, B=multiplication)  # disabled

# ----
# import points into rhino, e.g. from photoscan, then set this point primitive to the collection of points
# point cloud from rhino
number_slider_3 = Slider(0, range=0..100)
pt = ConstructPoint(XCoordinate=number_slider_3, YCoordinate=number_slider_3, ZCoordinate=number_slider_3)
pt_2 = Point([<point referenced from the Rhino model> x1986])
scale = Scale(Geometry=pt_2, Center=pt, Factor=Slider(6, range=0..10))  # -> Geometry, Transform
swatch = ColourSwatch(SwatchColor=RGB(255, 255, 255))  # disabled
preview = CustomPreview(Geometry=pt_2, Shader=swatch)  # disabled

# ----
# camera path input
C = Curve(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)  # disabled

# ----
# camera focus point
pt_3 = Point(Point(0, 0, 0))  # disabled

# ----
# add the displacement
# from second source
# sound source 2
panel_4 = Panel("C:\Users\master\Google Drive\ARCH 5350\final\data\poeme_[spectralcrest]_[scalars]")
pt_4 = ConstructPoint(
    XCoordinate=Slider(-4, range=-100..100),
    YCoordinate=Slider(-14, range=-100..100),
    ZCoordinate=Slider(19, range=-100..100))

# ----
# right click > "set one file path"
# and navigate to sound data file
# file import
path_2 = FilePath(panel_4)

# ----
# the file i showed on Sunday was audio sampled for loudness to scale the deform vector field
# 
# no point data should be in the file, it should just be a list of scalars
file_2 = ReadFile(File=path_2, PerLineParse=True)
num_2 = Number(file_2)

# ----
# right now this works by taking normalized data (i.e. from 0 to 1) and subtracting .5, so it ranges from -.5 to .5
# 
# then, the new values are compared to a threshold both positive and negative, and filters out only those above the threshold, for example a threshold of .2 would result in values above .2 or below -.2 getting 'true', and using a value of 0 would result in all values getting 'true'
# split against threshold
number_slider_4 = Slider(0.4, range=0..1)
subtraction_2 = Subtraction(A=num_2, B=number_slider_4)
number_slider_5 = Slider(0, range=0..1)
neg_2 = Negative(Value=number_slider_5)
smaller_2 = SmallerThan(FirstNumber=subtraction_2, SecondNumber=neg_2)  # -> SmallerThan, OrEqualTo
larger_2 = LargerThan(FirstNumber=subtraction_2, SecondNumber=number_slider_5)  # -> LargerThan, OrEqualTo
or_2 = GateOr(A=smaller_2.SmallerThan, B=larger_2.LargerThan)
dispatch_2 = Dispatch(List=subtraction_2, DispatchPattern=or_2)  # -> ListA, ListB
panel_5 = Panel(dispatch_2.ListA)
panel_6 = Panel(dispatch_2.ListB)

# ----
# scale sound data to effective point charge range
# add/sub with original value to have
# all repel/attract respectively
digit_scroller_2 = DigitScroller(Scroller_Digits=12, Scroller_Prefix="A", Scroller_Radix=11, Scroller_Value=5000)
multiplication_2 = Multiplication(A=digit_scroller_2, B=dispatch_2.ListA)
addition_2 = Addition(A=digit_scroller_2, B=multiplication_2)  # disabled

# ----
# point charge, field evaluation, and deformation
number_slider_6 = Slider(0, range=-100..100)
pt_5 = ConstructPoint(XCoordinate=Slider(0, range=-100..100), YCoordinate=Slider(0, range=-100..100), ZCoordinate=number_slider_6)
pcharge = PointCharge(Point=pt_5, Charge=multiplication, Decay=Slider(2.3, range=0..10))
R = Slider(10, range=0..10)
cubepop2d = CubePopulate2D(R=R, N=100)

# ----
# geometry
number_slider_7 = Slider(500, range=0..500)
toggle = BooleanToggle(False)
cluster = Cluster(R=R, N=number_slider_7)

# ----
# slider to slect deform vectors for each time partition
# 
# animate this to see deformation per time frame
number_slider_8 = Slider(1, range=0..500)
item = ListItem(List=pcharge, Index=number_slider_8, Wrap=toggle)

# ----
# animation
int = Integer(number_slider_8)  # disabled

python = PythonScript(s=number_slider_8)  # -> m; disabled
# ---------- python: Python ----------
import ghpythonlib.components as ghcomp

#ID = []
#value = []
#max = []
#min = []

m=[]

for slider in ghenv.Component.Params.Input:
    for s in slider.Sources:
        component = s.Attributes.GetTopLevel.DocObject
#        ID.append(str(component.InstanceGuid))
#        value.append(component.Slider.Value)
#        max.append(component.Slider.Maximum)
#        min.append(component.Slider.Minimum)

        m.append(component.Slider.Maximum)
# ---------- end python ----------
divide = DivideCurve(Curve=C, Count=python, Kinks=False)  # -> Points, Tangents, Parameters; disabled
item_2 = ListItem(List=divide.Points, Index=int, Wrap=True)  # disabled
ghpy_set_camera = GHPythonSetCameraScript(P=item_2, f=pt_3)  # disabled

pcharge_2 = PointCharge(Point=pt_4, Charge=multiplication_2, Decay=Slider(2.5, range=0..10))
item_3 = ListItem(List=pcharge_2, Index=number_slider_8, Wrap=toggle)
evf = EvaluateField(Field=item_3, Point=cubepop2d)  # -> Tensor, Strength

evf_2 = EvaluateField(Field=item, Point=cubepop2d)  # -> Tensor, Strength

addition_3 = Addition(A=evf_2.Tensor, B=evf.Tensor)

move = Move(Geometry=cubepop2d, Motion=addition_3)  # -> Geometry, Transform

# ----
# loft not working
# create metaball from new points and loft
number_slider_9 = Slider(-15, range=-100..100)
dom = ConstructDomain(DomainStart=number_slider_9, DomainEnd=Slider(15, range=-100..100))
range = Range(Domain=dom, Steps=Slider(7, range=0..100))
Z = UnitZ(Factor=range)
Y = UnitY(Factor=range)
xy = XYPlane(Origin=Z)
xz = XZPlane(Origin=Y)
entwine = Entwine(Branch00=xy, Branch01=xz, FlattenInputs=True)
cull = CullPattern(List=move.Geometry, CullPattern=[False, False, False, False, True])
metaball_t = MetaBallT(Points=cull, Plane=entwine, Threshold=Slider(0.72, range=0..10))  # -> flatten(Isocurve)
loft_opt = LoftOptions(Closed=False, Adjust=Toggle(True), Rebuild=Slider(7, range=0..10), Refit=0, Type=Slider(5, range=0..10))
loft = Loft(Curves=metaball_t, Options=loft_opt)  # disabled

# ----
# create spheres from points
number_slider_10 = Slider(1.2, range=0..10)
reduce = ListReduce(L=move.Geometry, B=number_slider_10)
spheres = SphereCloud(points=reduce, radius=Slider(0.5, range=0..1))

# ----
# cocoon mesh metaball
number_slider_11 = Slider(2, range=0..10)  # disabled
pt_6 = Point(move.Geometry)  # disabled
number_slider_12 = Slider(5, range=0..30)  # disabled
number_slider_13 = Slider(1, range=0..10)  # disabled
number_slider_14 = Slider(0.25, range=0..10)  # disabled
number_slider_15 = Slider(10, range=0..30)  # disabled
number_slider_16 = Slider(0.005, range=0..10)  # disabled
number_slider_17 = Slider(2, range=0..10)  # disabled
number_slider_18 = Slider(2, range=0..10)  # disabled
number_slider_19 = Slider(2, range=0..10)  # disabled
number_slider_20 = Slider(0.5, range=0..10)  # disabled
toggle_2 = BooleanToggle(False)  # disabled
point_charge = PointCharge(Point=pt_6, Radius=number_slider_12, ChargeStrength=number_slider_11)  # disabled
toggle_3 = BooleanToggle(False)  # disabled
cocoon = Cocoon(Charges=point_charge, Iso=number_slider_14, CellSize=number_slider_13, Execute=toggle_2, Simple=False)  # -> Mesh, RefinementData; disabled
preview_2 = CustomPreview(
    Geometry=cocoon.Mesh,
    Shader={ambient=RGB(0, 0, 0), diffuse=RGB(255, 105, 180), emission=RGB(76, 32, 54), shine=0.5, specular=RGB(255, 255, 255), transparency=0})  # disabled
refine = Refine(
    RefinementData=cocoon.RefinementData,
    Samples=number_slider_15,
    SampleSize=number_slider_20,
    SampleTolerance=number_slider_16,
    LaplacianSmoothing=number_slider_17,
    ValencePasses=number_slider_18,
    SubD=number_slider_19,
    Execute=toggle_3)  # disabled
wbedges = WeaverbirdsMeshEdges(MeshOrPolylines=refine)  # disabled

lng = ListLength(List=move.Geometry)
division = Division(A=lng, B=Slider(1.129, range=0..10))
reduce_2 = RandomReduce(List=move.Geometry, Reduction=division, Seed=1)

toggle_4 = BooleanToggle(False)  # disabled
panel_7 = Panel("ani_bake_layer")  # disabled
ghpy_bake = GHPythonBakeScript(G=spheres, L=panel_7, B=toggle_4)  # -> out, C; disabled
panel_8 = Panel("C:\Users\master\Documents\school\csci-5980\ani\")  # disabled

list = ValueList({"One": 1, "Two": 2, "Three": 2² - 1, "Four": Sqrt(16)}, selected="One")  # disabled
item_4 = ListItem(List=ghpy_bake.C, Index=list, Wrap=True)  # disabled

ghpy_render = GHPythonRenderScript(dir=panel_8, i=int, B=item_4)  # -> out, C; disabled
ghpy_delete = GHPythonDeleteScript(L=panel_7, B=ghpy_render.C)  # disabled

# ==== cluster GHPythonSetCameraScript: sets rhino camera position to "location", pointed at "focus"
P = ClusterInput()
f = ClusterInput()
camera = PythonScript(P=P, f=f)  # -> out, a
# ---------- camera: Python ----------
import rhinoscriptsyntax as rs
import scriptcontext as sc

sc.doc = ghdoc

location = rs.coerce3dpoint(P)
focus = rs.coerce3dpoint(f)

vp = sc.doc.Views.ActiveView.ActiveViewport
vp.SetCameraLocation(location, False)
vp.SetCameraDirection(focus - location, True)
# ---------- end camera ----------

# ==== cluster GHPythonBakeScript: bakes "G" (geometry) to "layer" if "active"
G = ClusterInput()
L = ClusterInput()
B = ClusterInput()
bake = PythonScript(G=G, L=L, B=B)  # -> out, C
# ---------- bake: Python ----------
import rhinoscriptsyntax as rs
import scriptcontext as sc
import Rhino

if B: 
    sc.doc = ghdoc
    doc_object = rs.coercerhinoobject(G)
    geometry = doc_object.Geometry
    attributes = doc_object.Attributes
    sc.doc = Rhino.RhinoDoc.ActiveDoc
    rhino_ref = sc.doc.Objects.Add(geometry, attributes)
    rs.ObjectLayer(rhino_ref, L)
    C = True
else:
    C = False
# ---------- end bake ----------
out = ClusterOutput(bake.out)
C = ClusterOutput(bake.C)

# ==== cluster GHPythonRenderScript: if "active" : renders rhino objects, saves image to "directory/i{0000}.png"
dir = ClusterInput()
i = ClusterInput()
B = ClusterInput()
render = PythonScript(dir=dir, i=i, B=B)  # -> out, C
# ---------- render: Python ----------
import rhinoscriptsyntax as rs


if B:
    rs.Command("_Render")
    
    savedLocation = dir + str(int(i)).zfill(4) + ".png"
    
    rs.Command("_-SaveRenderWindowAs \n\"" + savedLocation + "\"\n")
    rs.Command("_-CloseRenderWindow")
    C = True
else:
    C = False
# ---------- end render ----------
out = ClusterOutput(render.out)
C = ClusterOutput(render.C)

# ==== cluster GHPythonDeleteScript: deletes rhino objects from "layer"
L = ClusterInput()
B = ClusterInput()
delete = PythonScript(L=L, B=B)  # -> out
# ---------- delete: Python ----------
import rhinoscriptsyntax as rs
import scriptcontext as sc
import Rhino

if B:
    sc.doc = Rhino.RhinoDoc.ActiveDoc
    objs = rs.ObjectsByLayer(L)
    rs.DeleteObjects(objs)
# ---------- end delete ----------
out = ClusterOutput(delete)

# ==== cluster CubePopulate2D: Populates the surface of a cube of radius r centered at the origin with N points per face
R = ClusterInput()  # box radius dimension
neg = Negative(Value=R)
pt = ConstructPoint(XCoordinate=R, YCoordinate=R, ZCoordinate=R)
pt_2 = ConstructPoint(XCoordinate=neg, YCoordinate=neg, ZCoordinate=neg)
box = Box2Pt(PointA=pt, PointB=pt_2, Plane=PlaneXY(0, 0, 0))
debrep = DeconstructBrep(Brep=box)  # -> Faces, Edges, Vertices
N = ClusterInput()
pop2d = Populate2D(Region=debrep.Faces, Count=N, Seed=Slider(44, range=0..100))  # -> flatten(Population)
P = ClusterOutput(pop2d)

# ==== cluster SphereCloud: creates a sphere centered at each point in "P" with "radius"
points = ClusterInput()  # coordinates of sphere centers

# ----
# create spheres at each point
radius = ClusterInput()  # sphere radius
X = UnitX(Factor=radius)
Y = UnitY(Factor=radius)
Z = UnitZ(Factor=radius)
move = Move(Geometry=points, Motion=X)  # -> Geometry, Transform
move_2 = Move(Geometry=points, Motion=Y)  # -> Geometry, Transform
move_3 = Move(Geometry=points, Motion=Z)  # -> Geometry, Transform
sph4pt = Sphere4Pt(Point1=points, Point2=move.Geometry, Point3=move_2.Geometry, Point4=move_3.Geometry)  # -> Center, Radius, Sphere
S = ClusterOutput(sph4pt.Sphere)

# ==== cluster Cluster
R = ClusterInput()  # box radius dimension
neg = Negative(Value=R)
pt = ConstructPoint(XCoordinate=R, YCoordinate=R, ZCoordinate=R)
pt_2 = ConstructPoint(XCoordinate=neg, YCoordinate=neg, ZCoordinate=neg)
box = Box2Pt(PointA=pt, PointB=pt_2, Plane=PlaneXY(0, 0, 0))
N = ClusterInput()
pop3d = Populate3D(Region=box, Count=N, Seed=Slider(44, range=0..100))
P = ClusterOutput(pop3d)

# ==== cluster ListReduce: reduces list "L" by a factor of "B" ^-1
L = ClusterInput()
lng = ListLength(List=L)
B = ClusterInput()
division = Division(A=lng, B=B)
reduce = RandomReduce(List=L, Reduction=division, Seed=1)
L_2 = ClusterOutput(reduce)
