# Grasshopper definition audio_field_animation_improved_[WIP].gh (Grasshopper 0.9.76)
# plug-ins: Python Interpreter

# ----
# geometry
panel = Panel("C:\Users\master\Google Drive\ARCH 5350\final\data\poeme_[loudness]_[scalars]")
toggle = BooleanToggle(False)

# ----
# right click > "set one file path"
# and navigate to sound data file
# file import
path = FilePath(panel)

# ----
# the file i showed on Sunday was audio sampled for loudness to scale the deform vector field
# 
# no point data should be in the file, it should just be a list of scalars
file = ReadFile(File=path, PerLineParse=True)
num = Number(file)

# ----
# right now this works by taking normalized data (i.e. from 0 to 1) and subtracting .5, so it ranges from -.5 to .5
# 
# then, the new values are compared to a threshold both positive and negative, and filters out only those above the threshold, for example a threshold of .2 would result in values above .2 or below -.2 getting 'true'
# split against threshold
number_slider = Slider(0.06, range=0..1)
subtraction = Subtraction(A=num, B=number_slider)
number_slider_2 = Slider(0, range=0..1)
neg = Negative(Value=number_slider_2)
smaller = SmallerThan(FirstNumber=subtraction, SecondNumber=neg)  # -> SmallerThan, OrEqualTo
larger = LargerThan(FirstNumber=subtraction, SecondNumber=number_slider_2)  # -> LargerThan, OrEqualTo
or = GateOr(A=smaller.SmallerThan, B=larger.LargerThan)
dispatch = Dispatch(List=subtraction, DispatchPattern=or)  # -> ListA, ListB
panel_2 = Panel(dispatch.ListA)
panel_3 = Panel(dispatch.ListB)

# ----
# scale sound data to effective point charge range
# add/sub with original value to have
# all repel/attract respectively
digit_scroller = DigitScroller(Scroller_Digits=12, Scroller_Prefix="A", Scroller_Radix=11, Scroller_Value=5000)
multiplication = Multiplication(A=digit_scroller, B=dispatch.ListA)
addition = Addition(A=digit_scroller, B=multiplication)  # disabled

number_slider_3 = Slider(0.5, range=0..1)
X = UnitX(Factor=number_slider_3)
Y = UnitY(Factor=number_slider_3)
Z = UnitZ(Factor=number_slider_3)

# ----
# camera path input
path_2 = Curve(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)

# ----
# camera focus point
pt = Point(Point(0, 0, 0))

# ----
# add the displacement
# from second source
# sound source 2
panel_4 = Panel("C:\Users\master\Google Drive\ARCH 5350\final\data\poeme_[spectralcrest]_[scalars]")
pt_2 = ConstructPoint(
    XCoordinate=Slider(-4, range=-100..100),
    YCoordinate=Slider(-14, range=-100..100),
    ZCoordinate=Slider(19, range=-100..100))

# ----
# right click > "set one file path"
# and navigate to sound data file
# file import
path_3 = FilePath(panel_4)

# ----
# the file i showed on Sunday was audio sampled for loudness to scale the deform vector field
# 
# no point data should be in the file, it should just be a list of scalars
file_2 = ReadFile(File=path_3, PerLineParse=True)
num_2 = Number(file_2)

# ----
# right now this works by taking normalized data (i.e. from 0 to 1) and subtracting .5, so it ranges from -.5 to .5
# 
# then, the new values are compared to a threshold both positive and negative, and filters out only those above the threshold, for example a threshold of .2 would result in values above .2 or below -.2 getting 'true', and using a value of 0 would result in all values getting 'true'
# split against threshold
number_slider_4 = Slider(0.4, range=0..1)
subtraction_2 = Subtraction(A=num_2, B=number_slider_4)
number_slider_5 = Slider(0, range=0..1)
neg_2 = Negative(Value=number_slider_5)
smaller_2 = SmallerThan(FirstNumber=subtraction_2, SecondNumber=neg_2)  # -> SmallerThan, OrEqualTo
larger_2 = LargerThan(FirstNumber=subtraction_2, SecondNumber=number_slider_5)  # -> LargerThan, OrEqualTo
or_2 = GateOr(A=smaller_2.SmallerThan, B=larger_2.LargerThan)
dispatch_2 = Dispatch(List=subtraction_2, DispatchPattern=or_2)  # -> ListA, ListB
panel_5 = Panel(dispatch_2.ListA)
panel_6 = Panel(dispatch_2.ListB)

# ----
# scale sound data to effective point charge range
# add/sub with original value to have
# all repel/attract respectively
digit_scroller_2 = DigitScroller(Scroller_Digits=12, Scroller_Prefix="A", Scroller_Radix=11, Scroller_Value=5000)
multiplication_2 = Multiplication(A=digit_scroller_2, B=dispatch_2.ListA)
addition_2 = Addition(A=digit_scroller_2, B=multiplication_2)  # disabled

# ----
# point charge, field evaluation, and deformation
number_slider_6 = Slider(15, range=-100..100)
pt_3 = ConstructPoint(XCoordinate=number_slider_6, YCoordinate=Slider(15, range=-100..100), ZCoordinate=Slider(15, range=-100..100))
pcharge = PointCharge(Point=pt_3, Charge=multiplication, Decay=Slider(2.5, range=0..10))
R = Slider(10, range=0..10)
cubepop2d = CubePopulate2D(R=R, N=100)

# ----
# slider to slect deform vectors for each time partition
# 
# animate this to see deformation per time frame
number_slider_7 = Slider(500, range=0..500)
item = ListItem(List=pcharge, Index=number_slider_7, Wrap=toggle)

python = PythonScript(s=number_slider_7)  # -> m
# ---------- python: Python ----------
import ghpythonlib.components as ghcomp

#ID = []
#value = []
#max = []
#min = []

m=[]

for slider in ghenv.Component.Params.Input:
    for s in slider.Sources:
        component = s.Attributes.GetTopLevel.DocObject
#        ID.append(str(component.InstanceGuid))
#        value.append(component.Slider.Value)
#        max.append(component.Slider.Maximum)
#        min.append(component.Slider.Minimum)

        m.append(component.Slider.Maximum)
# ---------- end python ----------
int = Integer(number_slider_7)

frames = Slider(500, range=0..500)
frame = Slider(1, range=1..100)
divide = DivideCurve(Curve=path_2, Count=python, Kinks=False)  # -> Points, Tangents, Parameters
item_2 = ListItem(List=divide.Points, Index=int, Wrap=True)
ghpy_set_camera = GHPythonSetCameraScript(P=item_2, f=pt)

pcharge_2 = PointCharge(Point=pt_2, Charge=multiplication_2, Decay=Slider(2.5, range=0..10))
item_3 = ListItem(List=pcharge_2, Index=number_slider_7, Wrap=toggle)
evf = EvaluateField(Field=item_3, Point=cubepop2d)  # -> Tensor, Strength

evf_2 = EvaluateField(Field=item, Point=cubepop2d)  # -> Tensor, Strength

addition_3 = Addition(A=evf_2.Tensor, B=evf.Tensor)

move = Move(Geometry=cubepop2d, Motion=addition_3)  # -> Geometry, Transform

move_2 = Move(Geometry=move.Geometry, Motion=X)  # -> Geometry, Transform
move_3 = Move(Geometry=move.Geometry, Motion=Y)  # -> Geometry, Transform
move_4 = Move(Geometry=move.Geometry, Motion=Z)  # -> Geometry, Transform
sph4pt = Sphere4Pt(Point1=move_2.Geometry, Point2=move_3.Geometry, Point3=move_4.Geometry, Point4=move.Geometry)  # -> Center, Radius, Sphere
preview = CustomPreview(Geometry=sph4pt.Sphere, Shader=ColourSwatch(SwatchColor=RGB(255, 255, 255)))

ghpy_bake = GHPythonBakeScript(G=sph4pt.Sphere, L="ani_bake_layer", B=Toggle(False))  # -> out, C

# ----
# animation
list = ValueList({"One": 1, "Two": 2, "Three": 2² - 1, "Four": Sqrt(16)}, selected="One")
item_4 = ListItem(List=ghpy_bake.C, Index=list, Wrap=True)

ghpy_render = GHPythonRenderScript(dir="C:\Users\master\Documents\school\csci-5980\ani\", i=int, B=item_4)  # -> out, C
ghpy_delete = GHPythonDeleteScript(L="ani_bake_layer", B=ghpy_render.C)

# ==== cluster GHPythonSetCameraScript: sets rhino camera position to "location", pointed at "focus"
P = ClusterInput()
f = ClusterInput()
camera = PythonScript(P=P, f=f)  # -> out, a
# ---------- camera: Python ----------
import rhinoscriptsyntax as rs
import scriptcontext as sc

sc.doc = ghdoc

location = rs.coerce3dpoint(P)
focus = rs.coerce3dpoint(f)

vp = sc.doc.Views.ActiveView.ActiveViewport
vp.SetCameraLocation(location, False)
vp.SetCameraDirection(focus - location, True)
# ---------- end camera ----------

# ==== cluster GHPythonBakeScript: bakes "G" (geometry) to "layer" if "active"
G = ClusterInput()
L = ClusterInput()
B = ClusterInput()
bake = PythonScript(G=G, L=L, B=B)  # -> out, C
# ---------- bake: Python ----------
import rhinoscriptsyntax as rs
import scriptcontext as sc
import Rhino

if B: 
    sc.doc = ghdoc
    doc_object = rs.coercerhinoobject(G)
    geometry = doc_object.Geometry
    attributes = doc_object.Attributes
    sc.doc = Rhino.RhinoDoc.ActiveDoc
    rhino_ref = sc.doc.Objects.Add(geometry, attributes)
    rs.ObjectLayer(rhino_ref, L)
    C = True
else:
    C = False
# ---------- end bake ----------
out = ClusterOutput(bake.out)
C = ClusterOutput(bake.C)

# ==== cluster GHPythonRenderScript: if "active" : renders rhino objects, saves image to "directory/i{0000}.png"
dir = ClusterInput()
i = ClusterInput()
B = ClusterInput()
render = PythonScript(dir=dir, i=i, B=B)  # -> out, C
# ---------- render: Python ----------
import rhinoscriptsyntax as rs


if B:
    rs.Command("_Render")
    
    savedLocation = dir + str(int(i)).zfill(4) + ".png"
    
    rs.Command("_-SaveRenderWindowAs \n\"" + savedLocation + "\"\n")
    rs.Command("_-CloseRenderWindow")
    C = True
else:
    C = False
# ---------- end render ----------
out = ClusterOutput(render.out)
C = ClusterOutput(render.C)

# ==== cluster GHPythonDeleteScript: deletes rhino objects from "layer"
L = ClusterInput()
B = ClusterInput()
delete = PythonScript(L=L, B=B)  # -> out
# ---------- delete: Python ----------
import rhinoscriptsyntax as rs
import scriptcontext as sc
import Rhino

if B:
    sc.doc = Rhino.RhinoDoc.ActiveDoc
    objs = rs.ObjectsByLayer(L)
    rs.DeleteObjects(objs)
# ---------- end delete ----------
out = ClusterOutput(delete)

# ==== cluster CubePopulate2D: Populates the surface of a cube of radius r centered at the origin with N points per face
R = ClusterInput()  # box radius dimension
neg = Negative(Value=R)
pt = ConstructPoint(XCoordinate=R, YCoordinate=R, ZCoordinate=R)
pt_2 = ConstructPoint(XCoordinate=neg, YCoordinate=neg, ZCoordinate=neg)
box = Box2Pt(PointA=pt, PointB=pt_2, Plane=PlaneXY(0, 0, 0))
debrep = DeconstructBrep(Brep=box)  # -> Faces, Edges, Vertices
N = ClusterInput()
pop2d = Populate2D(Region=debrep.Faces, Count=N, Seed=Slider(44, range=0..100))  # -> flatten(Population)
P = ClusterOutput(pop2d)
