# Grasshopper definition audio_field_test.gh (Grasshopper 0.9.76)
# plug-ins: Heteroptera, Weaverbird

panel = Panel("C:\Users\master\Google Drive\ARCH 5350\final\data\poeme_[loudness]_[scalars]")

# ----
# right click > "set one file path"
# and navigate to sound data file
# file import
path = FilePath(panel)

# ----
# the file i showed on Sunday was audio sampled for loudness to scale the deform vector field
# 
# no point data should be in the file, it should just be a list of scalars
file = ReadFile(File=path, PerLineParse=True)
num = Number(file)

# ----
# right now this works by taking normalized data (i.e. from 0 to 1) and subtracting .5, so it ranges from -.5 to .5
# 
# then, the new values are compared to a threshold both positive and negative, and filters out only those above the threshold, for example a threshold of .2 would result in values above .2 or below -.2 getting 'true'
# split against threshold
number_slider = Slider(0.06, range=0..1)
subtraction = Subtraction(A=num, B=number_slider)
number_slider_2 = Slider(0, range=0..1)
neg = Negative(Value=number_slider_2)
smaller = SmallerThan(FirstNumber=subtraction, SecondNumber=neg)  # -> SmallerThan, OrEqualTo
larger = LargerThan(FirstNumber=subtraction, SecondNumber=number_slider_2)  # -> LargerThan, OrEqualTo
or = GateOr(A=smaller.SmallerThan, B=larger.LargerThan)
dispatch = Dispatch(List=subtraction, DispatchPattern=or)  # -> ListA, ListB
panel_2 = Panel(dispatch.ListA)
panel_3 = Panel(dispatch.ListB)

# ----
# scale sound data to effective point charge range
# add/sub with original value to have
# all repel/attract respectively
digit_scroller = DigitScroller(Scroller_Digits=12, Scroller_Prefix="A", Scroller_Radix=11, Scroller_Value=5000)
multiplication = Multiplication(A=digit_scroller, B=dispatch.ListA)
addition = Addition(A=digit_scroller, B=multiplication)  # disabled

toggle = BooleanToggle(False)
R = Slider(10, range=0..10)
cluster = Cluster(R=R)
wbvertices = WeaverbirdsVerticesComponent(MeshClosedPolylinesGroup=cluster, Weld=True)

# ----
# add the displacement
# from second source
# sound source 2
panel_4 = Panel("C:\Users\master\Google Drive\ARCH 5350\final\data\poeme_[spectralcrest]_[scalars]")
pt = ConstructPoint(
    XCoordinate=Slider(-4, range=-100..100),
    YCoordinate=Slider(-14, range=-100..100),
    ZCoordinate=Slider(19, range=-100..100))

# ----
# right click > "set one file path"
# and navigate to sound data file
# file import
path_2 = FilePath(panel_4)

# ----
# the file i showed on Sunday was audio sampled for loudness to scale the deform vector field
# 
# no point data should be in the file, it should just be a list of scalars
file_2 = ReadFile(File=path_2, PerLineParse=True)
num_2 = Number(file_2)

# ----
# right now this works by taking normalized data (i.e. from 0 to 1) and subtracting .5, so it ranges from -.5 to .5
# 
# then, the new values are compared to a threshold both positive and negative, and filters out only those above the threshold, for example a threshold of .2 would result in values above .2 or below -.2 getting 'true', and using a value of 0 would result in all values getting 'true'
# split against threshold
number_slider_3 = Slider(0.4, range=0..1)
subtraction_2 = Subtraction(A=num_2, B=number_slider_3)
number_slider_4 = Slider(0, range=0..1)
neg_2 = Negative(Value=number_slider_4)
smaller_2 = SmallerThan(FirstNumber=subtraction_2, SecondNumber=neg_2)  # -> SmallerThan, OrEqualTo
larger_2 = LargerThan(FirstNumber=subtraction_2, SecondNumber=number_slider_4)  # -> LargerThan, OrEqualTo
or_2 = GateOr(A=smaller_2.SmallerThan, B=larger_2.LargerThan)
dispatch_2 = Dispatch(List=subtraction_2, DispatchPattern=or_2)  # -> ListA, ListB
panel_5 = Panel(dispatch_2.ListA)
panel_6 = Panel(dispatch_2.ListB)

# ----
# scale sound data to effective point charge range
# add/sub with original value to have
# all repel/attract respectively
digit_scroller_2 = DigitScroller(Scroller_Digits=12, Scroller_Prefix="A", Scroller_Radix=11, Scroller_Value=5000)
multiplication_2 = Multiplication(A=digit_scroller_2, B=dispatch_2.ListA)
addition_2 = Addition(A=digit_scroller_2, B=multiplication_2)  # disabled

# ----
# point charge, field evaluation, and deformation
number_slider_5 = Slider(15, range=-100..100)
pt_2 = ConstructPoint(XCoordinate=Slider(15, range=-100..100), YCoordinate=Slider(15, range=-100..100), ZCoordinate=number_slider_5)
pcharge = PointCharge(Point=pt_2, Charge=multiplication, Decay=Slider(2.5, range=0..10))
R_2 = Slider(10, range=0..10)
cubepop2d = CubePopulate2D(R=R_2, N=100)

# ----
# slider to slect deform vectors for each time partition
# 
# animate this to see deformation per time frame
number_slider_6 = Slider(148, range=0..500)
item = ListItem(List=pcharge, Index=number_slider_6, Wrap=toggle)

# ----
# new layer name per animation frame
panel_7 = Panel("test")
int = Integer(number_slider_6)
entwine = Entwine(Branch00=panel_7, Branch01=int, FlattenInputs=True)  # -> flatten(Result)
join = TextJoin(Text=entwine, Join="_")
panel_8 = Panel(join)

pcharge_2 = PointCharge(Point=pt, Charge=multiplication_2, Decay=Slider(2.5, range=0..10))
item_2 = ListItem(List=pcharge_2, Index=number_slider_6, Wrap=toggle)
evf = EvaluateField(Field=item_2, Point=cubepop2d)  # -> Tensor, Strength

evf_2 = EvaluateField(Field=item, Point=cubepop2d)  # -> Tensor, Strength

addition_3 = Addition(A=evf_2.Tensor, B=evf.Tensor)

move = Move(Geometry=cubepop2d, Motion=addition_3)  # -> Geometry, Transform

# ----
# loft not working
# create metaball from new points and loft
number_slider_7 = Slider(-15, range=-100..100)
dom = ConstructDomain(DomainStart=number_slider_7, DomainEnd=Slider(15, range=-100..100))
range = Range(Domain=dom, Steps=Slider(47, range=0..100))
Z = UnitZ(Factor=range)
Y = UnitY(Factor=range)
xy = XYPlane(Origin=Z)  # disabled
xz = XZPlane(Origin=Y)
entwine_2 = Entwine(Branch00=xy, Branch01=xz, FlattenInputs=True)
cull = CullPattern(List=move.Geometry, CullPattern=[False, False, False, False, True])
metaball_t = MetaBallT(Points=cull, Plane=entwine_2, Threshold=Slider(3.5, range=0..10))  # -> flatten(Isocurve); disabled
loft_opt = LoftOptions(Closed=False, Adjust=Toggle(True), Rebuild=Slider(7, range=0..10), Refit=0, Type=Slider(5, range=0..10))
loft = Loft(Curves=metaball_t, Options=loft_opt)  # disabled

# ----
# auto-bake for animation
toggle_2 = BooleanToggle(False)
qb = QuickBaker(Geometry=move.Geometry, Layer="test", Bake=toggle_2, referenceAll=4)

# ----
# custom preview filter
swatch = ColourSwatch(SwatchColor=RGB(255, 255, 255))
preview = CustomPreview(Geometry=move.Geometry, Shader=swatch)

# ==== cluster CubePopulate2D: Populates the surface of a cube of radius r centered at the origin with N points per face
R = ClusterInput()  # box radius dimension
neg = Negative(Value=R)
pt = ConstructPoint(XCoordinate=R, YCoordinate=R, ZCoordinate=R)
pt_2 = ConstructPoint(XCoordinate=neg, YCoordinate=neg, ZCoordinate=neg)
box = Box2Pt(PointA=pt, PointB=pt_2, Plane=PlaneXY(0, 0, 0))
debrep = DeconstructBrep(Brep=box)  # -> Faces, Edges, Vertices
N = ClusterInput()
pop2d = Populate2D(Region=debrep.Faces, Count=N, Seed=Slider(44, range=0..100))  # -> flatten(Population)
P = ClusterOutput(pop2d)

# ==== cluster Cluster
R = ClusterInput()  # box radius dimension
neg = Negative(Value=R)
pt = ConstructPoint(XCoordinate=R, YCoordinate=R, ZCoordinate=R)
pt_2 = ConstructPoint(XCoordinate=neg, YCoordinate=neg, ZCoordinate=neg)
box = Box2Pt(PointA=pt, PointB=pt_2, Plane=PlaneXY(0, 0, 0))
debrep = DeconstructBrep(Brep=box)  # -> Faces, Edges, Vertices
mesh = MeshBrep(
    Brep=box,
    Settings={GridMaxCount=0, GridMinCount=16, JaggedSeams=False, MaxEdgeLength=0, MinEdgeLength=0.0001, MinTolerance=0, Refine=True, RefineAngle=0, RelativeTolerance=0.65, SimplePlanes=True, Tolerance=0})
wbsplitquads = WeaverbirdsConstantQuadsSplitSubdivision(MeshCurves=mesh, Level=Slider(2, range=0..10), SmoothNakedEdges=1)
O = ClusterOutput(wbsplitquads)
