# Grasshopper definition point_cloud_deform_basic.gh (Grasshopper 0.9.76)

# ----
# box centered at origin
number_slider = Slider(10, range=0..10)
neg = Negative(Value=number_slider)
pt = ConstructPoint(XCoordinate=neg, YCoordinate=neg, ZCoordinate=neg)
pt_2 = ConstructPoint(XCoordinate=number_slider, YCoordinate=number_slider, ZCoordinate=number_slider)
box = Box2Pt(PointA=pt_2, PointB=pt, Plane=PlaneXY(0, 0, 0))

# ----
# file import
path = FilePath("C:\Users\master\Documents\responsive.json")
file = ReadFile(File=path, PerLineParse=True)
num = Number(file)
lng = ListLength(List=num)

# ----
# deform cube face point cloud
# with static charge and decay
number_slider_2 = Slider(15, range=0..100)
debrep = DeconstructBrep(Brep=box)  # -> Faces, Edges, Vertices
pt_3 = ConstructPoint(XCoordinate=number_slider_2, YCoordinate=Slider(15, range=0..100), ZCoordinate=Slider(15, range=0..100))
digit_scroller = DigitScroller(Scroller_Digits=12, Scroller_Prefix="Charge", Scroller_Radix=11, Scroller_Value=5000)
pop2d = Populate2D(Region=debrep.Faces, Count=lng, Seed=Slider(44, range=0..100))  # -> flatten(Population)
pcharge = PointCharge(Point=pt_3, Charge=digit_scroller, Decay=Slider(2.5, range=0..10))
evf = EvaluateField(Field=pcharge, Point=pop2d)  # -> Tensor, Strength
order = PointOrder(Points=pop2d)
move = Move(Geometry=pop2d, Motion=evf.Tensor)  # -> Geometry, Transform; disabled

# ----
# deform vector preview
number_slider_3 = Slider(1.5, range=0..10)
lng_2 = ListLength(List=pop2d)
division = Division(A=lng_2, B=number_slider_3)
reduce = RandomReduce(List=pop2d, Reduction=division, Seed=1)
evf_2 = EvaluateField(Field=pcharge, Point=reduce)  # -> Tensor, Strength
vdisex = VectorDisplayEx(Point=reduce, Vector=evf_2.Tensor, Colour=ColourSwatch(SwatchColor=RGB(255, 255, 255)), Width=Slider(1, range=0..10))
