# Grasshopper definition sound_3d_point_cloud_metaball.gh (Grasshopper 0.9.76)

# ----
# XY,XZ Metaball isos for sound data
R = Slider(10, range=0..10)
number_slider = Slider(10, range=-10..10)
number_slider_2 = Slider(-10, range=-10..10)
neg = Negative(Value=R)
neg_2 = Negative(Value=R)
multiplication = Multiplication(A=R, B=Slider(1.2, range=0..2))
multiplication_2 = Multiplication(A=neg, B=Slider(1.2, range=0..2))
path = FilePath("C:\Users\master\Google Drive\ARCH 5350\final\data\HMHF - Drums_[freq;power;phase]_[3Dpts].json")
pt = ConstructPoint(XCoordinate=neg_2, YCoordinate=neg_2, ZCoordinate=neg_2)
coords = ImportCoordinates(File=path, Separator=",", XIndex=0, YIndex=1, ZIndex=2)
digit_scroller = DigitScroller(Scroller_Digits=12, Scroller_Prefix="B", Scroller_Radix=9, Scroller_Value=1.1)
dom = ConstructDomain(DomainStart=multiplication, DomainEnd=multiplication_2)
lng = ListLength(List=coords)
range = Range(Domain=dom, Steps=Slider(44, range=0..100))
division = Division(A=lng, B=digit_scroller)
Z = UnitZ(Factor=range)
Y = UnitY(Factor=range)
reduce = RandomReduce(List=coords, Reduction=division, Seed=1)
multiplication_3 = Multiplication(A=reduce, B=Slider(20, range=0..100))
xy = XYPlane(Origin=Z)
xz = XZPlane(Origin=Y)
entwine = Entwine(Branch00=xy, Branch01=xz, FlattenInputs=True)
move = Move(Geometry=multiplication_3, Motion=pt)  # -> Geometry, Transform
metaball_t = MetaBallT(Points=move.Geometry, Plane=entwine, Threshold=Slider(2, range=0..10))  # -> simplify(Isocurve)

# ----
# XY,XZ Metaball isos for random 3D pop
number_slider_3 = Slider(1.2, range=0..2)
number_slider_4 = Slider(-10, range=-10..10)
number_slider_5 = Slider(10, range=-10..10)
number_slider_6 = Slider(10, range=0..10)
multiplication_4 = Multiplication(A=number_slider_6, B=number_slider_3)
neg_3 = Negative(Value=number_slider_6)
multiplication_5 = Multiplication(A=neg_3, B=Slider(1.2, range=0..2))
pt_2 = ConstructPoint(XCoordinate=number_slider_6, YCoordinate=number_slider_6, ZCoordinate=number_slider_6)
pt_3 = ConstructPoint(XCoordinate=neg_3, YCoordinate=neg_3, ZCoordinate=neg_3)
dom_2 = ConstructDomain(DomainStart=multiplication_4, DomainEnd=multiplication_5)
range_2 = Range(Domain=dom_2, Steps=Slider(43, range=0..100))
box = Box2Pt(PointA=pt_2, PointB=pt_3, Plane=PlaneXY(0, 0, 0))
Z_2 = UnitZ(Factor=range_2)
Y_2 = UnitY(Factor=range_2)
xy_2 = XYPlane(Origin=Z_2)
xz_2 = XZPlane(Origin=Y_2)
entwine_2 = Entwine(Branch00=xy_2, Branch01=xz_2, FlattenInputs=True)
pop3d = Populate3D(Region=box, Count=Slider(23, range=0..100), Seed=Slider(77, range=0..100))
metaball_t_2 = MetaBallT(Points=pop3d, Plane=entwine_2, Threshold=Slider(0.19, range=0..1))  # -> simplify(Isocurve); disabled

panel = Panel("C:\Users\master\Google Drive\ARCH 5350\final\data\HMHF - Drums_[freq;power;phase]_[3Dpts].json")
panel_2 = Panel("C:\Users\master\Google Drive\ARCH 5350\final\data\HMHF - Vocals_[freq;power;phase]_[3Dpts].json")
panel_3 = Panel("C:\Users\master\Google Drive\ARCH 5350\final\data\HMHF - Piano_[freq;power;phase]_[3Dpts].json")

# ----
# import coordinates from file,
# cull, normalize, explode
cluster = Cluster_2(path=panel)

cluster_2 = Cluster_2(path=panel_3)
cluster_3 = Cluster_2(path=panel_2)
number_slider_7 = Slider(8, range=0..10)
move_2 = Move(Geometry=cluster_3, Motion=pt_3)  # -> Geometry, Transform
move_3 = Move(Geometry=cluster_2, Motion=pt_3)  # -> Geometry, Transform
move_4 = Move(Geometry=cluster, Motion=pt_3)  # -> Geometry, Transform
metaball_t_3 = MetaBallT(Points=move_2.Geometry, Plane=entwine_2, Threshold=number_slider_7)  # -> simplify(Isocurve)
metaball_t_4 = MetaBallT(Points=move_3.Geometry, Plane=entwine_2, Threshold=number_slider_7)  # -> simplify(Isocurve)
metaball_t_5 = MetaBallT(Points=move_4.Geometry, Plane=entwine_2, Threshold=number_slider_7)  # -> simplify(Isocurve)

# ----
# extrude into panels
cluster_4 = Cluster()

preview = CustomPreview(Geometry=metaball_t_3, Shader=ColourSwatch(SwatchColor=RGB(0, 0, 0)))
preview_2 = CustomPreview(Geometry=metaball_t_4, Shader=ColourSwatch(SwatchColor=RGB(255, 255, 255)))
preview_3 = CustomPreview(Geometry=metaball_t_5, Shader=ColourSwatch(SwatchColor=RGB(255, 0, 0)))

# ==== cluster Cluster
E = ClusterInput()
boundary = BoundarySurfaces(Edges=E)
deplane = DeconstructPlane(Plane=boundary)  # -> Origin, XAxis, YAxis, ZAxis
division = Division(A=deplane.ZAxis, B=Slider(4, range=0..10))
rev = Reverse(Vector=division)
division_2 = Division(A=rev, B=Slider(2, range=0..10))
move = Move(Geometry=boundary, Motion=division_2)  # -> Geometry, Transform
extr = Extrude(Base=move.Geometry, Direction=division)
# extrude into panels
swatch = ColourSwatch(SwatchColor=RGB(255, 255, 255))
preview = CustomPreview(Geometry=extr, Shader=swatch)

# ==== cluster Cluster_2
path = ClusterInput()
number_slider = Slider(2, range=0..10)
path_2 = FilePath(path)
coords = ImportCoordinates(File=path_2, Separator=",", XIndex=0, YIndex=1, ZIndex=2)
culln = CullNth(List=coords, CullFrequency=number_slider)
culln_2 = CullNth(List=culln, CullFrequency=number_slider)
culln_3 = CullNth(List=culln_2, CullFrequency=number_slider)
multiplication = Multiplication(A=culln_3, B=Slider(20, range=0..100))
R = ClusterOutput(multiplication)
