# Grasshopper definition animation_test.gh (Grasshopper 0.9.76)

a = Slider(0.9, range=0..10)
pt = ConstructPoint(XCoordinate=a, YCoordinate=a, ZCoordinate=a)
neg = Negative(Value=pt)
box = Box2Pt(PointA=pt, PointB=neg, Plane=PlaneXY(0, 0, 0))

# ----
# camera path input
path = Curve(<curve referenced from the Rhino model>)

# ----
# camera focus point
pt_2 = Point(<point referenced from the Rhino model>)

frames = Slider(100, range=0..100)
frame = Slider(100, range=1..100)
divide = DivideCurve(Curve=path, Count=frames, Kinks=False)  # -> Points, Tangents, Parameters
item = ListItem(List=divide.Points, Index=frame, Wrap=True)
ghpy_set_camera = GHPythonSetCameraScript(P=item, f=pt_2)

ghpy_bake = GHPythonBakeScript(G=box, L="ani_bake_layer", B=Toggle(False))  # -> out, C
ghpy_render = GHPythonRenderScript(dir="C:\Users\master\Documents\school\csci-5980\ani\", i=frame, B=ghpy_bake.C)  # -> out, C
ghpy_delete = GHPythonDeleteScript(L="ani_bake_layer", B=ghpy_render.C)

# ==== cluster GHPythonSetCameraScript: sets rhino camera position to "location", pointed at "focus"
P = ClusterInput()
f = ClusterInput()
camera = PythonScript(P=P, f=f)  # -> out, a
# ---------- camera: Python ----------
import rhinoscriptsyntax as rs
import scriptcontext as sc

sc.doc = ghdoc

location = rs.coerce3dpoint(P)
focus = rs.coerce3dpoint(f)

vp = sc.doc.Views.ActiveView.ActiveViewport #this over my head
vp.SetCameraLocation(location, False)
vp.SetCameraDirection(focus - location, True)
# ---------- end camera ----------

# ==== cluster GHPythonBakeScript: bakes "G" (geometry) to "layer" if "active"
G = ClusterInput()
L = ClusterInput()
B = ClusterInput()
bake = PythonScript(G=G, L=L, B=B)  # -> out, C
# ---------- bake: Python ----------
import rhinoscriptsyntax as rs
import scriptcontext as sc
import Rhino

if B: 
    sc.doc = ghdoc
    doc_object = rs.coercerhinoobject(G)
    geometry = doc_object.Geometry
    attributes = doc_object.Attributes
    sc.doc = Rhino.RhinoDoc.ActiveDoc
    rhino_ref = sc.doc.Objects.Add(geometry, attributes)
    rs.ObjectLayer(rhino_ref, L)
    C = True
else:
    C = False
# ---------- end bake ----------
out = ClusterOutput(bake.out)
C = ClusterOutput(bake.C)

# ==== cluster GHPythonRenderScript: if "active" : renders rhino objects, saves image to "directory/i{0000}.png"
dir = ClusterInput()
i = ClusterInput()
B = ClusterInput()
render = PythonScript(dir=dir, i=i, B=B)  # -> out, C
# ---------- render: Python ----------
import rhinoscriptsyntax as rs


if B:
    
    
    rs.Command("_Render")
    
    savedLocation = dir + str(int(i)).zfill(4) + ".png"
    
    rs.Command("_-SaveRenderWindowAs \n\"" + savedLocation + "\"\n")
    rs.Command("_-CloseRenderWindow")
    C = True
else:
    C = False
# ---------- end render ----------
out = ClusterOutput(render.out)
C = ClusterOutput(render.C)

# ==== cluster GHPythonDeleteScript: deletes rhino objects from "layer"
L = ClusterInput()
B = ClusterInput()
delete = PythonScript(L=L, B=B)  # -> out
# ---------- delete: Python ----------
import rhinoscriptsyntax as rs
import scriptcontext as sc
import Rhino

if B:
    sc.doc = Rhino.RhinoDoc.ActiveDoc
    objs = rs.ObjectsByLayer(L)
    rs.DeleteObjects(objs)
# ---------- end delete ----------
out = ClusterOutput(delete)
