# Grasshopper definition process_camera_anchor_test.gh (Grasshopper 0.9.76)
# plug-ins: Python Interpreter

camera = PythonScript()  # -> out, a; same code as camera
panel = Panel("GHPython")
render = PythonScript()  # -> out, C; same code as render
bake = PythonScript()  # -> out, C; same code as bake
delete = PythonScript()  # -> out; same code as delete

# ----
# input: GH slider
# 
# output: slider's max value
python = PythonScript()  # -> m
# ---------- python: Python ----------
import ghpythonlib.components as ghcomp

#ID = []
#value = []
#max = []
#min = []

m=[]

for slider in ghenv.Component.Params.Input:
    for s in slider.Sources:
        component = s.Attributes.GetTopLevel.DocObject
#        ID.append(str(component.InstanceGuid))
#        value.append(component.Slider.Value)
#        max.append(component.Slider.Maximum)
#        min.append(component.Slider.Minimum)

        m.append(component.Slider.Maximum)
# ---------- end python ----------

# ----
# camera path input
C = Curve(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)

python_2 = PythonScript(L_a="camera_anchors", L_p="camera_paths", L_f="camera_foci")  # -> P, C, t
# ---------- python_2: Python ----------
import scriptcontext as sc
import Rhino
import Grasshopper as gh

sc.doc = Rhino.RhinoDoc.ActiveDoc
anchors = sc.doc.Objects.FindByLayer(L_a)
P = [gh.Kernel.Types.GH_Point(__.Id) for __ in anchors]
paths = sc.doc.Objects.FindByLayer(L_p)
print(paths[0])
print(paths[0].Id)
print(paths[0].Geometry)
print(gh.Kernel.Types.GH_Curve(paths[0].Geometry))
C = [gh.Kernel.Types.GH_Curve(__.Geometry) for __ in paths]
foci = sc.doc.Objects.FindByLayer(L_f)
t = [gh.Kernel.Types.GH_Point(__.Id) for __ in foci]
# ---------- end python_2 ----------

list = ValueList({"One": 1, "Two": 2, "Three": 2² - 1, "Four": Sqrt(16)}, selected="One")
pt = Point([<point referenced from the Rhino model> x4])
item = ListItem(List=pt, Index=list, Wrap=True)
pt_2 = Point(Point(0, 0, 0))
ghpy_set_camera = GHPythonSetCameraScript(P=item, f=pt_2, B=Toggle(True))

int = Integer()
panel_2 = Panel(python_2.P)
panel_3 = Panel(python_2.C)
panel_4 = Panel(python_2.t)
pt_3 = Point(python_2.P)
pt_4 = Point(python_2.t)
crv = Curve(python_2.C)
pdecon = Deconstruct(Point=pt_3)  # -> XComponent, YComponent, ZComponent

# ----
# camera focus point
pt_5 = Point(Point(0, 0, 0))

python_3 = PythonScript()  # -> m; same code as python
divide = DivideCurve(Curve=C, Count=python_3, Kinks=False)  # -> Points, Tangents, Parameters
item_2 = ListItem(List=divide.Points, Index=int, Wrap=True)
ghpy_set_camera_2 = GHPythonSetCameraScript(P=item_2, f=pt_5)

panel_5 = Panel(pdecon.XComponent)
panel_6 = Panel(pdecon.YComponent)
panel_7 = Panel(pdecon.ZComponent)

ghpy_bake = GHPythonBakeScript(L="ani_bake_layer", B=Toggle(False))  # -> out, C

list_2 = ValueList({"One": 1, "Two": 2, "Three": 2² - 1, "Four": Sqrt(16)}, selected="One")
item_3 = ListItem(List=ghpy_bake.C, Index=list_2, Wrap=True)

ghpy_render = GHPythonRenderScript(dir="C:\Users\master\Documents\school\csci-5980\ani\", i=int, B=item_3)  # -> out, C
ghpy_delete = GHPythonDeleteScript(L="ani_bake_layer", B=ghpy_render.C)

# ==== cluster GHPythonSetCameraScript: sets rhino camera position to "location", pointed at "focus"
P = ClusterInput()
f = ClusterInput()
B = ClusterInput()
camera = PythonScript(P=P, f=f, B=B)  # -> out, a
# ---------- camera: Python ----------
import rhinoscriptsyntax as rs
import scriptcontext as sc

if B == True:
    sc.doc = ghdoc

    location = rs.coerce3dpoint(P)
    focus = rs.coerce3dpoint(f)

    vp = sc.doc.Views.ActiveView.ActiveViewport
    vp.SetCameraLocation(location, False)
    vp.SetCameraDirection(focus - location, True)
# ---------- end camera ----------

# ==== cluster GHPythonBakeScript: bakes "G" (geometry) to "layer" if "active"
G = ClusterInput()
L = ClusterInput()
B = ClusterInput()
bake = PythonScript(G=G, L=L, B=B)  # -> out, C
# ---------- bake: Python ----------
import rhinoscriptsyntax as rs
import scriptcontext as sc
import Rhino

if B: 
    sc.doc = ghdoc
    doc_object = rs.coercerhinoobject(G)
    geometry = doc_object.Geometry
    attributes = doc_object.Attributes
    sc.doc = Rhino.RhinoDoc.ActiveDoc
    rhino_ref = sc.doc.Objects.Add(geometry, attributes)
    rs.ObjectLayer(rhino_ref, L)
    C = True
else:
    C = False
# ---------- end bake ----------
out = ClusterOutput(bake.out)
C = ClusterOutput(bake.C)

# ==== cluster GHPythonRenderScript: if "active" : renders rhino objects, saves image to "directory/i{0000}.png"
dir = ClusterInput()
i = ClusterInput()
B = ClusterInput()
render = PythonScript(dir=dir, i=i, B=B)  # -> out, C
# ---------- render: Python ----------
import rhinoscriptsyntax as rs


if B:
    rs.Command("_Render")
    
    savedLocation = dir + str(int(i)).zfill(4) + ".png"
    
    rs.Command("_-SaveRenderWindowAs \n\"" + savedLocation + "\"\n")
    rs.Command("_-CloseRenderWindow")
    C = True
else:
    C = False
# ---------- end render ----------
out = ClusterOutput(render.out)
C = ClusterOutput(render.C)

# ==== cluster GHPythonDeleteScript: deletes rhino objects from "layer"
L = ClusterInput()
B = ClusterInput()
delete = PythonScript(L=L, B=B)  # -> out
# ---------- delete: Python ----------
import rhinoscriptsyntax as rs
import scriptcontext as sc
import Rhino

if B:
    sc.doc = Rhino.RhinoDoc.ActiveDoc
    objs = rs.ObjectsByLayer(L)
    rs.DeleteObjects(objs)
# ---------- end delete ----------
out = ClusterOutput(delete)
