# Grasshopper definition parametric surface box.gh (Grasshopper 0.9.76)

brep = Brep(<brep referenced from the Rhino model>)
number_slider = Slider(7, range=1..100)

brep_2 = Brep(<brep referenced from the Rhino model>)  # disabled
number_slider_2 = Slider(10, range=1..100)  # disabled
srf = Surface(<surface referenced from the Rhino model>)
divide = DivideDomain²(Domain=brep_2, UCount=number_slider_2, VCount=number_slider_2)  # disabled
subsrf = Isotrim(Surface=brep_2, Domain=divide)  # disabled
number_slider_3 = Slider(1, range=1..100)  # disabled
debrep = DeconstructBrep(Brep=subsrf)  # -> Faces, Edges, Vertices; disabled
sbox = SurfaceBox(Surface=brep_2, Domain=debrep.Faces, Height=number_slider_3)  # disabled
srf_2 = Surface(<surface referenced from the Rhino model>)  # disabled
bvol = BoundaryVolume(Boundaries=srf_2)  # disabled
morph = BoxMorph(Geometry=srf_2, Reference=sbox, Target=bvol)  # disabled

number_slider_4 = Slider(25, range=1..100)  # disabled
srf_3 = Surface(<surface referenced from the Rhino model>)  # disabled
number_slider_5 = Slider(0.23, range=0..1)  # disabled
sdivide = DivideSurface(Surface=srf_3, UCount=number_slider_4, VCount=number_slider_4)  # -> Points, Normals, Parameters; disabled
circle = CircleCNR(Center=sdivide.Points, Normal=sdivide.Normals, Radius=number_slider_5)  # disabled

divide_2 = DivideDomain²(Domain=brep, UCount=number_slider, VCount=number_slider)
toggle = BooleanToggle(False)
toggle_2 = BooleanToggle(False)
toggle_3 = BooleanToggle(False)
toggle_4 = BooleanToggle(True)
subsrf_2 = Isotrim(Surface=brep, Domain=divide_2)
number_slider_6 = Slider(4, range=1..100)
debrep_2 = DeconstructBrep(Brep=subsrf_2)  # -> Faces, Edges, Vertices
cull = CullPattern(List=debrep_2.Vertices, CullPattern=[False, False, True, True])
srf_4 = Surface(<surface referenced from the Rhino model>)
pt = Point(<point referenced from the Rhino model>)
dist = Distance(PointA=cull, PointB=pt)
bbox = BoundingBox(Content=srf_4, Plane=PlaneXY(0, 0, 0))  # -> Box, Box_2
division = Division(A=1, B=dist)
multiplication = Multiplication(A=division, B=Slider(10, range=1..100))
sbox_2 = SurfaceBox(Surface=brep, Domain=debrep_2.Faces, Height=multiplication)
morph_2 = BoxMorph(Geometry=srf_4, Reference=bbox.Box, Target=sbox_2)
