# Grasshopper definition andrew voronoi.gh (Grasshopper 0.9.76)
# plug-ins: Python Interpreter

# ----
# constructing a height field from image sampler data
path = FilePath("D:\img\walls\all\5feb87990f459ce0a7dbc85c79eb276b.jpg")  # disabled
img = ImportImage(File=path)  # disabled
bbox = BoundingBox(Content=img, Plane=PlaneXY(0, 0, 0))  # -> Box, Box_2; disabled
debrep = DeconstructBrep(Brep=bbox.Box)  # -> Faces, Edges, Vertices; disabled
dim = Dimensions(Surface=debrep.Faces)  # -> UDimension, VDimension; disabled
number_slider = Slider(50, range=0..100)  # disabled
division = Division(A=dim.UDimension, B=dim.VDimension)  # disabled
multiplication = Multiplication(A=division, B=number_slider)  # disabled
int = Integer(multiplication)  # disabled
one_over_x = OneOverX(Value=int)  # disabled
one_over_x_2 = OneOverX(Value=number_slider)  # disabled
recgrid = Rectangular(Plane=PlaneXY(0, 0, 0), SizeX=one_over_x, SizeY=one_over_x_2, ExtentX=int, ExtentY=number_slider)  # -> Cells, Points; disabled

# ----
# gadget to retrieve image bounding box
path_2 = FilePath("C:\Users\master\Downloads\435cf546f40d376abcc13474d52e8c9c.jpg")
img_2 = ImportImage(File=path_2)
bbox_2 = BoundingBox(Content=img_2, Plane=PlaneXY(0, 0, 0))  # -> Box, Box_2
debrep_2 = DeconstructBrep(Brep=bbox_2.Box)  # -> Faces, Edges, Vertices
dim_2 = Dimensions(Surface=debrep_2.Faces)  # -> UDimension, VDimension
pt = Point(Point(0, 0, 0))
X = UnitX(Factor=dim_2.UDimension)
Y = UnitY(Factor=dim_2.VDimension)
pt_2 = Point(pt)
pt_3 = Point(pt)
pt_4 = Point(pt)
move = Move(Geometry=pt_4, Motion=Y)  # -> Geometry, Transform
move_2 = Move(Geometry=pt_3, Motion=X)  # -> Geometry, Transform
rec_3pt = Rectangle3Pt(PointA=pt_2, PointB=move_2.Geometry, PointC=move.Geometry)  # -> Rectangle, Length

rec = Rectangle({Plane=PlaneXY(0, 0, 0), Size=Domain2(u=0..1, v=0..1)})  # disabled
number_slider_2 = Slider(64, range=1..1000)  # disabled
number_slider_3 = Slider(1, range=1..100)  # disabled
number_slider_4 = Slider(2, range=1..10)  # disabled
division_2 = Division(A=number_slider_2, B=number_slider_4)  # disabled
pop2d = Populate2D(Region=rec, Count=number_slider_2, Seed=number_slider_3)  # disabled
cull = CullPattern(List=pop2d, CullPattern=[False, False, True, True])  # disabled
voronoi = Voronoi(Points=cull, Boundary=rec, BruteForceOverride=False)  # disabled
number_slider_5 = Slider(2, range=1..10)  # disabled
lng = ListLength(List=voronoi)  # disabled
division_3 = Division(A=lng, B=number_slider_5)  # disabled
reduce = RandomReduce(List=voronoi, Reduction=division_3, Seed=1)  # disabled
Z = UnitZ(Factor=1)  # disabled
extr = Extrude(Base=reduce, Direction=Z)  # disabled

path_3 = FilePath("D:\uhm\docs\school\csci-5980\project 2\Untitled.png")  # disabled
rec_2 = Rectangle({Plane=PlaneXY(-5, -5, 0), Size=Domain2(u=0..10, v=0..10)})  # disabled
number_slider_6 = Slider(20, range=1..100)  # disabled
number_slider_7 = Slider(20, range=1..100)  # disabled
img_3 = ImportImage(File=path_3, Rectangle=rec, XSamples=number_slider_6, YSamples=number_slider_7)  # disabled

number_slider_8 = Slider(1, range=1..5)  # disabled
recgrid_2 = Rectangular(Plane=PlaneXY(0, 0, 0), SizeX=number_slider_8, SizeY=number_slider_8, ExtentX=int, ExtentY=number_slider)  # -> Cells, Points; disabled
number_slider_9 = Slider(20, range=0..50)  # disabled
multiplication_2 = Multiplication(A=number_slider_9)  # disabled
Z_2 = UnitZ(Factor=multiplication_2)  # disabled
move_3 = Move(Geometry=recgrid_2.Points, Motion=Z_2)  # -> Geometry, Transform; disabled

# ----
# samples image, discards white pixels (0 brightness value in source image)
number_slider_10 = Slider(256, range=1..2056)
pop2d_2 = Populate2D(Region=rec_3pt.Rectangle, Count=number_slider_10, Seed=Slider(1, range=1..100))
dispatch = Dispatch(List=pop2d_2, DispatchPattern=<missing>)  # -> ListA, ListB
pt_5 = Point(dispatch.ListA)
pt_6 = Point(dispatch.ListB)

number_slider_11 = Slider(1.3, range=0..10)  # disabled
number_slider_12 = Slider(5, range=0..20)  # disabled
number_slider_13 = Slider(5, range=0..20)  # disabled
number_slider_14 = Slider(3.4, range=0..10)  # disabled
number_slider_15 = Slider(40, range=0..100)  # disabled
number_slider_16 = Slider(0.7, range=0..10)  # disabled
cir = Circle(Plane=PlaneXY(0, 0, 0), Radius=number_slider_11)  # disabled
number_slider_17 = Slider(0.6, range=0..5)  # disabled
subtraction = Subtraction(A=number_slider_15, B=1)  # disabled
pi = Pi(Factor=number_slider_16)  # disabled
pframes = PerpFrames(Curve=cir, Count=number_slider_15, Align=True)  # -> Frames, Parameters; disabled
polygon = Polygon(Plane=pframes.Frames, Radius=number_slider_14, Segments=number_slider_13, FilletRadius=0)  # -> Polygon, Length; disabled
division_4 = Division(A=pi, B=3)  # disabled
fillet = Fillet(Curve=polygon.Polygon, Radius=number_slider_17)  # disabled
division_5 = Division(A=number_slider_15, B=2)  # disabled
multiplication_3 = Multiplication(A=division_4, B=number_slider_12)  # disabled
range = Range(Domain=multiplication_3, Steps=subtraction)  # disabled
panel = Panel(range)  # disabled
rotate = Rotate(Geometry=fillet, Angle=range, Plane=polygon.Polygon)  # -> Geometry, Transform; disabled
dom = ConstructDomain(DomainStart=0, DomainEnd=division_5)  # disabled
dom_2 = ConstructDomain(DomainStart=division_5, DomainEnd=subtraction)  # disabled
subset = SubList(List=rotate.Geometry, Domain=dom, Wrap=True)  # -> List, Index; disabled
panel_2 = Panel(subset.List)  # disabled
item = ListItem(List=pframes.Frames, Index=0, Wrap=True)  # disabled
subset_2 = SubList(List=rotate.Geometry, Domain=dom_2, Wrap=True)  # -> List, Index; disabled
item_2 = ListItem(List=rotate.Geometry, Index=0, Wrap=True)  # disabled
rotate_2 = Rotate(Geometry=item_2, Angle=multiplication_3, Plane=item)  # -> Geometry, Transform; disabled
loft = Loft(Curves=subset.List, Options={Adjust=False, Closed=False, LoftEnds=0, LoftSimp=0, LoftType=0, Rebuild=10, Refit=0.01})  # disabled
merge = Merge(Data1=flatten(subset_2.List), Data2=flatten(rotate_2.Geometry))  # disabled
loft_2 = Loft(Curves=merge, Options={Adjust=False, Closed=False, LoftEnds=0, LoftSimp=0, LoftType=0, Rebuild=10, Refit=0.01})  # disabled
panel_3 = Panel(subset_2.List)  # disabled
merge_2 = Merge(Data1=loft, Data2=loft_2)  # disabled
brep = Brep(merge_2)  # disabled
move_4 = Move(Geometry=brep, Motion=Vector(0, 0, 10))  # -> Geometry, Transform; disabled

# ----
# constructs voronoi, **randomly removes cells (areas with larger cells will appear less fragmented)** DISABLED
voronoi_2 = Voronoi(Points=dispatch.ListB, Boundary=rec_3pt.Rectangle, BruteForceOverride=False)
lng_2 = ListLength(List=voronoi_2)
division_6 = Division(A=lng_2, B=Slider(1.288, range=1..4))
reduce_2 = RandomReduce(List=voronoi_2, Reduction=division_6, Seed=1)

# ----
# brings in a point from rhino to use in a distance-based probabilistic culling algorithm for the voronoi cells
number_slider_18 = Slider(1, range=1..2)
pt_7 = Point(<point referenced from the Rhino model>)
Z_3 = UnitZ(Factor=0.05)
move_5 = Move(Geometry=pt_7, Motion=Z_3)  # -> Geometry, Transform
python = PythonScript(B=rec_3pt.Rectangle, x=voronoi_2, y=pt_7, z=number_slider_18, u=Slider(1, range=1..100))  # -> a; inputs x: list
# ---------- python: Python ----------
#pseudo-random culling algorithm with variable probability based on distance to a control point
import rhinoscriptsyntax as rs
import random


bb = rs.ExplodeCurves(B)
print(bb)
print(rs.Distance(rs.CurveStartPoint(bb[0]), rs.CurveEndPoint(bb[0])))
s = z / rs.Distance(rs.CurveStartPoint(bb[0]), rs.CurveEndPoint(bb[0]))

random.seed(u)
def cull(curves, pt):
    cull = []
    for curve in curves:
        if rs.CloseCurve(curve) == False:
            print('invalid curve: not closed')
        #calculate the distance from the control point to the centroid of the curve
        d = rs.Distance(pt, rs.CurveAreaCentroid(curve)[0])
        #scale culling probability by s (probably distance to an attractor point)
        if(random.random() < 1 / (s * d)):
            cull.append(curve)
    for curve in cull:
        curves.remove(curve)
    return curves
a = cull(x, y)
# ---------- end python ----------
tag = TextTag(Location=move_5.Geometry, Text="ctrl pt", Colour=ColourSwatch(SwatchColor=RGB(255, 255, 255)))
preview = CustomPreview(Geometry=python, Shader=ColourSwatch(SwatchColor=RGB(255, 255, 255)))

# ----
# gadget to display "shadow geometry"
# (i.e. move down 1)
Z_4 = UnitZ(Factor=1)
rev = Reverse(Vector=Z_4)
move_6 = Move(Geometry=voronoi_2, Motion=rev)  # -> Geometry, Transform
preview_2 = CustomPreview(Geometry=move_6.Geometry, Shader=ColourSwatch(SwatchColor=RGBA(74, 74, 74, 155)))

# ----
# constructs a surface (using extrude along curve) from rhino geometry, and projects the voronoi onto it, creating a mesh from the result
project = Project(Curve=reduce_2, Brep=move_4.Geometry, Direction=Vector(0, 0, 1))
topoly = CurveToPolyline(Curve=project, ToleranceDistance=0, ToleranceAngle=0)  # -> Polyline, Segments
fpatch = FragmentPatch(Boundary=topoly.Polyline)

# ----
# just another way to get the mesh,
# extruding the cells and testing for intersection
explode = Explode(Curve=topoly.Polyline, Recursive=True)  # -> Segments, Vertices; disabled
pline = PolyLine(Vertices=explode.Vertices, Closed=False)  # disabled
fpatch_2 = FragmentPatch(Boundary=pline)  # disabled

preview_3 = CustomPreview(Geometry=fpatch, Shader=ColourSwatch(SwatchColor=RGB(30, 140, 199)))
